# Dynamo graph 3Python.dyn (Dynamo 3.4.0.6127)

python_script = Python()  # PythonNet3; unwired: IN[0]
# ---------- python_script.python (14 lines) ----------
# Load the Python Standard and DesignScript Libraries
import sys
import clr
clr.AddReference('ProtoGeometry')
from Autodesk.DesignScript.Geometry import *
import platform
a=platform.python_version()
# The inputs to this node will be stored as a list in the IN variables.
dataEnteringNode = IN

# Place your code below this line

# Assign your output to the OUT variable.
OUT = a
# ----------------------------------------
watch = Watch(python_script)
python_script_2 = Python()  # IronPython3; unwired: IN[0]; same code as python_script
watch_2 = Watch(python_script_2)
python_script_3 = Python()  # CPython3; unwired: IN[0]; same code as python_script
watch_3 = Watch(python_script_3)
